# Grasshopper definition rhino3dm_hops_001.gh (Grasshopper 1.0.7)
# plug-ins: Hops

number_slider = Slider(14, range=0..100)
number_slider_2 = Slider(35, range=0..100)
number_slider_3 = Slider(45, range=0..100)
number_slider_4 = Slider(6, range=0..100)
# Points
createpoint = Hops(
    X=[number_slider, number_slider_2, number_slider_3],
    Y=[number_slider, number_slider_2, number_slider_3, number_slider_4],
    Z=[number_slider, number_slider_3, number_slider_4],
    CacheResultsInMemory=True,
    CacheSolveResults=True,
    RemoteDefinitionLocation="http://127.0.0.1:5000/createpoint",
    RemoteSolveVersion=(0, 1, 0),
    ShowInput_Enabled=False,
    ShowInput_Path=False,
    SynchronousSolve=True)
# hops server with flask
# rhino3dm in app.py app
# createBoolean
createboolean = Hops(
    Operation=Slider(1, range=0..1),
    CacheResultsInMemory=True,
    CacheSolveResults=True,
    RemoteDefinitionLocation="http://127.0.0.1:5000/createBoolean",
    RemoteSolveVersion=(0, 1, 0),
    ShowInput_Enabled=False,
    ShowInput_Path=False,
    SynchronousSolve=True)
explode_tree = ExplodeTree(Data=graft(createpoint))  # -> Branch0, Branch1, Branch2, Branch3
panel = Panel(createboolean)
# createCurve
createcurve = Hops(
    Start=explode_tree.Branch0,
    End=explode_tree.Branch1,
    CacheResultsInMemory=True,
    CacheSolveResults=True,
    RemoteDefinitionLocation="http://127.0.0.1:5000/createCurve",
    RemoteSolveVersion=(0, 1, 0),
    ShowInput_Enabled=False,
    ShowInput_Path=False,
    SynchronousSolve=True)
# createLine
createcurve_2 = Hops(
    Start=explode_tree.Branch2,
    End=explode_tree.Branch3,
    CacheResultsInMemory=True,
    CacheSolveResults=True,
    RemoteDefinitionLocation="http://127.0.0.1:5000/createLine",
    RemoteSolveVersion=(0, 1, 0),
    ShowInput_Enabled=False,
    ShowInput_Path=False,
    SynchronousSolve=True)
# createVector
# Curves
number_slider_5 = Slider(12, range=0..100)
# Surfaces
createsurface = Hops(
    CornerA=explode_tree.Branch0,
    CornerB=explode_tree.Branch1,
    CornerC=explode_tree.Branch2,
    CornerD=explode_tree.Branch3,
    CacheResultsInMemory=True,
    CacheSolveResults=True,
    RemoteDefinitionLocation="http://127.0.0.1:5000/createSurface",
    RemoteSolveVersion=(0, 1, 0),
    ShowInput_Enabled=False,
    ShowInput_Path=False,
    SynchronousSolve=True)
merge = Merge(Data1=explode_tree.Branch0, Data2=explode_tree.Branch1, Data3=explode_tree.Branch2, Data4=explode_tree.Branch3)  # -> flatten(Result)
createvector = Hops(
    X=number_slider_5,
    Y=number_slider_5,
    Z=number_slider_5,
    CacheResultsInMemory=True,
    CacheSolveResults=True,
    RemoteDefinitionLocation="http://127.0.0.1:5000/createVector",
    RemoteSolveVersion=(0, 1, 0),
    ShowInput_Enabled=False,
    ShowInput_Path=False,
    SynchronousSolve=True)
# Breps
createbrep = Hops(
    Surface=createsurface,
    CacheResultsInMemory=True,
    CacheSolveResults=True,
    RemoteDefinitionLocation="http://127.0.0.1:5000/createBrep",
    RemoteSolveVersion=(0, 1, 0),
    ShowInput_Enabled=False,
    ShowInput_Path=False,
    SynchronousSolve=True)
polyline = PolyLine(Vertices=merge, Closed=False)
deconstruct_brep = DeconstructBrep(Brep=createbrep)  # -> Faces, Edges, Vertices
