# Grasshopper definition rhino3dm_hops_curves_002.gh (Grasshopper 1.0.7)
# plug-ins: Hops

# ----
# createVector
# Breps
# Surfaces
# Points
# Curves
# createLine
# createCurve
number_slider = Slider(15, range=0..100)
number_slider_2 = Slider(35, range=0..100)
number_slider_3 = Slider(45, range=0..100)
number_slider_4 = Slider(6, range=0..100)
# hops server with flask
# rhino3dm in app.py
# Getting Started with
# rhino3dm development
# API for Python 3.10
number_slider_5 = Slider(17, range=0..100)
createpoint = Hops(
    X=[number_slider, number_slider_2, number_slider_3],
    Y=[number_slider, number_slider_2, number_slider_3, number_slider_4],
    Z=[number_slider, number_slider_3, number_slider_4],
    CacheResultsInMemory=True,
    CacheSolveResults=True,
    RemoteDefinitionLocation="http://127.0.0.1:5000/createpoint",
    RemoteSolveVersion=(0, 1, 0),
    ShowInput_Enabled=False,
    ShowInput_Path=False,
    SynchronousSolve=True)
explode_tree = ExplodeTree(Data=graft(createpoint))  # -> Branch0, Branch1, Branch2, Branch3
createvector = Hops(
    X=number_slider_5,
    Y=number_slider_5,
    Z=number_slider_5,
    CacheResultsInMemory=True,
    CacheSolveResults=True,
    RemoteDefinitionLocation="http://127.0.0.1:5000/createVector",
    RemoteSolveVersion=(0, 1, 0),
    ShowInput_Enabled=False,
    ShowInput_Path=False,
    SynchronousSolve=True)
panel = Panel(createvector)
createcurve = Hops(
    Start=explode_tree.Branch0,
    End=explode_tree.Branch1,
    CacheResultsInMemory=True,
    CacheSolveResults=True,
    RemoteDefinitionLocation="http://127.0.0.1:5000/createCurve",
    RemoteSolveVersion=(0, 1, 0),
    ShowInput_Enabled=False,
    ShowInput_Path=False,
    SynchronousSolve=True)
createcurve_2 = Hops(
    Start=explode_tree.Branch2,
    End=explode_tree.Branch3,
    CacheResultsInMemory=True,
    CacheSolveResults=True,
    RemoteDefinitionLocation="http://127.0.0.1:5000/createLine",
    RemoteSolveVersion=(0, 1, 0),
    ShowInput_Enabled=False,
    ShowInput_Path=False,
    SynchronousSolve=True)
createsurface = Hops(
    CornerA=explode_tree.Branch0,
    CornerB=explode_tree.Branch1,
    CornerC=explode_tree.Branch2,
    CornerD=explode_tree.Branch3,
    CacheResultsInMemory=True,
    CacheSolveResults=True,
    RemoteDefinitionLocation="http://127.0.0.1:5000/createSurface",
    RemoteSolveVersion=(0, 1, 0),
    ShowInput_Enabled=False,
    ShowInput_Path=False,
    SynchronousSolve=True)
merge = Merge(Data1=explode_tree.Branch0, Data2=explode_tree.Branch1, Data3=explode_tree.Branch2, Data4=explode_tree.Branch3)  # -> flatten(Result)
createbrep = Hops(
    Surface=createsurface,
    CacheResultsInMemory=True,
    CacheSolveResults=True,
    RemoteDefinitionLocation="http://127.0.0.1:5000/createBrep",
    RemoteSolveVersion=(0, 1, 0),
    ShowInput_Enabled=False,
    ShowInput_Path=False,
    SynchronousSolve=True)
polyline = PolyLine(Vertices=merge, Closed=False)
deconstruct_brep = DeconstructBrep(Brep=createbrep)  # -> Faces, Edges, Vertices

# ----
# class rhino3dm.Curve
# """curve domain
# Domain
# rhino3dm.Interval: Gets or sets the domain of the curve.
# """
# crvDomainT0T1
curve = Curve(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)
number_slider_6 = Slider(7, range=0..10)
# """
# curve dimension
# Dimension
# int: Gets the dimension of the object.
# The dimension is typically three.
# For parameter space trimming curves the dimension is two.
# In rare cases the dimension can be one or greater than three.
# """
# crvDomainT0T1
curve_domain = CurveDomain(Curve=reparameterize(curve))  # -> Curve, Domain
# """
# curve PointAtStart
# PointAtStart
# rhino3dm.Point3d:
# Evaluates point at the start of the curve.
# """
# crvPointAtStart
crvisperiodic = Hops(
    Curve=curve,
    CacheResultsInMemory=True,
    CacheSolveResults=True,
    RemoteDefinitionLocation="http://127.0.0.1:5000/crvIsPeriodic",
    RemoteSolveVersion=(0, 1, 0),
    ShowInput_Enabled=False,
    ShowInput_Path=False,
    SynchronousSolve=True)
# """
# curve IsPeriodic
# IsPeriodic
# bool: Gets a value indicating whether
# or not this curve is considered to be Periodic.
# ""
# crvIsPeriodic"
crvisclosed = Hops(
    Curve=curve,
    CacheResultsInMemory=True,
    CacheSolveResults=True,
    RemoteDefinitionLocation="http://127.0.0.1:5000/crvIsClosed",
    RemoteSolveVersion=(0, 1, 0),
    ShowInput_Enabled=False,
    ShowInput_Path=False,
    SynchronousSolve=True)
# """
# Degree
# int: Gets the maximum algebraic degree
# of any span or a good estimate if
# curve spans are not algebraic.
# """
# crvDegree
crvspancount = Hops(
    Curve=curve,
    CacheResultsInMemory=True,
    CacheSolveResults=True,
    RemoteDefinitionLocation="http://127.0.0.1:5000/crvSpanCount",
    RemoteSolveVersion=(0, 1, 0),
    ShowInput_Enabled=False,
    ShowInput_Path=False,
    SynchronousSolve=True)
# """
# curve IsClosed
# IsClosed
# bool: Gets a value indicating whether
# or not this curve is a closed curve.
# """
# crvIsClosed
crvdegree = Hops(
    Curve=curve,
    CacheResultsInMemory=True,
    CacheSolveResults=True,
    RemoteDefinitionLocation="http://127.0.0.1:5000/crvDegree",
    RemoteSolveVersion=(0, 1, 0),
    ShowInput_Enabled=False,
    ShowInput_Path=False,
    SynchronousSolve=True)
crvdomaint0t1 = Hops(
    Curve=curve,
    CacheResultsInMemory=True,
    CacheSolveResults=True,
    RemoteDefinitionLocation="http://127.0.0.1:5000/crvDomainT0T1",
    RemoteSolveVersion=(0, 1, 0),
    ShowInput_Enabled=False,
    ShowInput_Path=False,
    SynchronousSolve=True)  # -> T0, T1
# """
# curve span count
# SpanCount
# int: Gets the number of non-empty smooth (c-infinity) spans in the curve.
# """
# crvSpanCount
crvdimension = Hops(
    Curve=curve,
    CacheResultsInMemory=True,
    CacheSolveResults=True,
    RemoteDefinitionLocation="http://127.0.0.1:5000/crvDimension",
    RemoteSolveVersion=(0, 1, 0),
    ShowInput_Enabled=False,
    ShowInput_Path=False,
    SynchronousSolve=True)
# """
# curve PointAtEnd
# PointAtEnd
# rhino3dm.Point3d:
# Evaluates point at the end of the curve.
# ""
# crvPointAtEnd"
crvpointatstart = Hops(
    Curve=curve,
    CacheResultsInMemory=True,
    CacheSolveResults=True,
    RemoteDefinitionLocation="http://127.0.0.1:5000/crvPointAtStart",
    RemoteSolveVersion=(0, 1, 0),
    ShowInput_Enabled=False,
    ShowInput_Path=False,
    SynchronousSolve=True)
# """
# curve TangentAtStart
# TangentAtStart
# rhino3dm.Vector3d: Evaluates the unit
# tangent vector at the start of the curve.
# ""
# crvTangentAtStart"
crvpointatend = Hops(
    Curve=curve,
    CacheResultsInMemory=True,
    CacheSolveResults=True,
    RemoteDefinitionLocation="http://127.0.0.1:5000/crvPointAtEnd",
    RemoteSolveVersion=(0, 1, 0),
    ShowInput_Enabled=False,
    ShowInput_Path=False,
    SynchronousSolve=True)
# """
# curve TangentAtEnd
# TangentAtEnd
# rhino3dm.Vector3d: Evaluates the unit
# tangent vector at the end of the curve.
# """
# crvTangentAtEnd
crvtangentatstart = Hops(
    Curve=curve,
    CacheResultsInMemory=True,
    CacheSolveResults=True,
    RemoteDefinitionLocation="http://127.0.0.1:5000/crvTangentAtStart",
    RemoteSolveVersion=(0, 1, 0),
    ShowInput_Enabled=False,
    ShowInput_Path=False,
    SynchronousSolve=True)
# """
# static Create Control Point Curve
# staticCreateControlPointCurve(points, degree)
# Constructs a curve from a set of control-point locations.
# 
# Parameters:
# points (list[rhino3dm.Point3d]) – Control points.
# degree (int) – Degree of curve.
# The number of control points must be at least degree+1.
# Return type:
# rhino3dm.Curve
# """
# crvCP5
crvtangentatend = Hops(
    Curve=curve,
    CacheResultsInMemory=True,
    CacheSolveResults=True,
    RemoteDefinitionLocation="http://127.0.0.1:5000/crvTangentAtEnd",
    RemoteSolveVersion=(0, 1, 0),
    ShowInput_Enabled=False,
    ShowInput_Path=False,
    SynchronousSolve=True)
panel_2 = Panel(crvpointatstart)
panel_3 = Panel(crvtangentatend)
panel_4 = Panel(crvtangentatstart)
panel_5 = Panel(crvdimension)
panel_6 = Panel(crvisclosed)
panel_7 = Panel([crvdomaint0t1.T0, crvdomaint0t1.T1])
panel_8 = Panel(crvspancount)
panel_9 = Panel(crvdegree)
panel_10 = Panel(crvisperiodic)
series = Series(Start=0, Step=1, Count=number_slider_6)
sine = Sine(Value=series)
multiplication = Multiplication(A=sine, B=Slider(12, range=0..100))
construct_point = ConstructPoint(XCoordinate=series, YCoordinate=series, ZCoordinate=multiplication)
subtraction = Subtraction(A=number_slider_6, B="1")
panel_11 = Panel(construct_point)
crvcp5 = Hops(
    Points=construct_point,
    Degree=subtraction,
    CacheResultsInMemory=False,
    CacheSolveResults=False,
    RemoteDefinitionLocation="http://127.0.0.1:5000/crvCP5",
    RemoteSolveVersion=(0, 1, 0),
    ShowInput_Enabled=False,
    ShowInput_Path=False,
    SynchronousSolve=True)
panel_12 = Panel(crvcp5)
