# Grasshopper definition rhino3dm_hops_curves_MASTER.gh (Grasshopper 1.0.7)
# plug-ins: Hops

# ----
# createVector
# Breps
# Surfaces
# Points
# Curves
# createLine
# createCurve
number_slider = Slider(15, range=0..100)
number_slider_2 = Slider(35, range=0..100)
number_slider_3 = Slider(45, range=0..100)
number_slider_4 = Slider(6, range=0..100)
# hops server with flask
# rhino3dm in app.py
# Getting Started with
# rhino3dm development
# API for Python 3.10
number_slider_5 = Slider(17, range=0..100)
createpoint = Hops(
    X=[number_slider, number_slider_2, number_slider_3],
    Y=[number_slider, number_slider_2, number_slider_3, number_slider_4],
    Z=[number_slider, number_slider_3, number_slider_4],
    CacheResultsInMemory=True,
    CacheSolveResults=True,
    RemoteDefinitionLocation="http://127.0.0.1:5000/createpoint",
    RemoteSolveVersion=(0, 1, 0),
    ShowInput_Enabled=False,
    ShowInput_Path=False,
    SynchronousSolve=True)
explode_tree = ExplodeTree(Data=graft(createpoint))  # -> Branch0, Branch1, Branch2, Branch3
createvector = Hops(
    X=number_slider_5,
    Y=number_slider_5,
    Z=number_slider_5,
    CacheResultsInMemory=True,
    CacheSolveResults=True,
    RemoteDefinitionLocation="http://127.0.0.1:5000/createVector",
    RemoteSolveVersion=(0, 1, 0),
    ShowInput_Enabled=False,
    ShowInput_Path=False,
    SynchronousSolve=True)
panel = Panel(createvector)
createcurve = Hops(
    Start=explode_tree.Branch0,
    End=explode_tree.Branch1,
    CacheResultsInMemory=True,
    CacheSolveResults=True,
    RemoteDefinitionLocation="http://127.0.0.1:5000/createCurve",
    RemoteSolveVersion=(0, 1, 0),
    ShowInput_Enabled=False,
    ShowInput_Path=False,
    SynchronousSolve=True)
createcurve_2 = Hops(
    Start=explode_tree.Branch2,
    End=explode_tree.Branch3,
    CacheResultsInMemory=True,
    CacheSolveResults=True,
    RemoteDefinitionLocation="http://127.0.0.1:5000/createLine",
    RemoteSolveVersion=(0, 1, 0),
    ShowInput_Enabled=False,
    ShowInput_Path=False,
    SynchronousSolve=True)
createsurface = Hops(
    CornerA=explode_tree.Branch0,
    CornerB=explode_tree.Branch1,
    CornerC=explode_tree.Branch2,
    CornerD=explode_tree.Branch3,
    CacheResultsInMemory=True,
    CacheSolveResults=True,
    RemoteDefinitionLocation="http://127.0.0.1:5000/createSurface",
    RemoteSolveVersion=(0, 1, 0),
    ShowInput_Enabled=False,
    ShowInput_Path=False,
    SynchronousSolve=True)
merge = Merge(Data1=explode_tree.Branch0, Data2=explode_tree.Branch1, Data3=explode_tree.Branch2, Data4=explode_tree.Branch3)  # -> flatten(Result)
createbrep = Hops(
    Surface=createsurface,
    CacheResultsInMemory=True,
    CacheSolveResults=True,
    RemoteDefinitionLocation="http://127.0.0.1:5000/createBrep",
    RemoteSolveVersion=(0, 1, 0),
    ShowInput_Enabled=False,
    ShowInput_Path=False,
    SynchronousSolve=True)
polyline = PolyLine(Vertices=merge, Closed=False)
deconstruct_brep = DeconstructBrep(Brep=createbrep)  # -> Faces, Edges, Vertices

# ----
# class rhino3dm.Curve
# """curve domain
# Domain
# rhino3dm.Interval: Gets or sets the domain of the curve.
# """
# crvDomainT0T1
curve = Curve(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)
# """
# curve dimension
# Dimension
# int: Gets the dimension of the object.
# The dimension is typically three.
# For parameter space trimming curves the dimension is two.
# In rare cases the dimension can be one or greater than three.
# """
# crvDomainT0T1
curve_domain = CurveDomain(Curve=reparameterize(curve))  # -> Curve, Domain
# """
# curve PointAtStart
# PointAtStart
# rhino3dm.Point3d:
# Evaluates point at the start of the curve.
# """
# crvPointAtStart
crvisperiodic = Hops(
    Curve=curve,
    CacheResultsInMemory=True,
    CacheSolveResults=True,
    RemoteDefinitionLocation="http://127.0.0.1:5000/crvIsPeriodic",
    RemoteSolveVersion=(0, 1, 0),
    ShowInput_Enabled=False,
    ShowInput_Path=False,
    SynchronousSolve=True)
# """
# curve IsPeriodic
# IsPeriodic
# bool: Gets a value indicating whether
# or not this curve is considered to be Periodic.
# ""
# crvIsPeriodic"
crvisclosed = Hops(
    Curve=curve,
    CacheResultsInMemory=True,
    CacheSolveResults=True,
    RemoteDefinitionLocation="http://127.0.0.1:5000/crvIsClosed",
    RemoteSolveVersion=(0, 1, 0),
    ShowInput_Enabled=False,
    ShowInput_Path=False,
    SynchronousSolve=True)
# """
# Degree
# int: Gets the maximum algebraic degree
# of any span or a good estimate if
# curve spans are not algebraic.
# """
# crvDegree
crvspancount = Hops(
    Curve=curve,
    CacheResultsInMemory=True,
    CacheSolveResults=True,
    RemoteDefinitionLocation="http://127.0.0.1:5000/crvSpanCount",
    RemoteSolveVersion=(0, 1, 0),
    ShowInput_Enabled=False,
    ShowInput_Path=False,
    SynchronousSolve=True)
# """
# curve IsClosed
# IsClosed
# bool: Gets a value indicating whether
# or not this curve is a closed curve.
# """
# crvIsClosed
crvdegree = Hops(
    Curve=curve,
    CacheResultsInMemory=True,
    CacheSolveResults=True,
    RemoteDefinitionLocation="http://127.0.0.1:5000/crvDegree",
    RemoteSolveVersion=(0, 1, 0),
    ShowInput_Enabled=False,
    ShowInput_Path=False,
    SynchronousSolve=True)
crvdomaint0t1 = Hops(
    Curve=curve,
    CacheResultsInMemory=True,
    CacheSolveResults=True,
    RemoteDefinitionLocation="http://127.0.0.1:5000/crvDomainT0T1",
    RemoteSolveVersion=(0, 1, 0),
    ShowInput_Enabled=False,
    ShowInput_Path=False,
    SynchronousSolve=True)  # -> T0, T1
# """
# curve span count
# SpanCount
# int: Gets the number of non-empty smooth (c-infinity) spans in the curve.
# """
# crvSpanCount
crvdimension = Hops(
    Curve=curve,
    CacheResultsInMemory=True,
    CacheSolveResults=True,
    RemoteDefinitionLocation="http://127.0.0.1:5000/crvDimension",
    RemoteSolveVersion=(0, 1, 0),
    ShowInput_Enabled=False,
    ShowInput_Path=False,
    SynchronousSolve=True)
# """
# curve PointAtEnd
# PointAtEnd
# rhino3dm.Point3d:
# Evaluates point at the end of the curve.
# ""
# crvPointAtEnd"
crvpointatstart = Hops(
    Curve=curve,
    CacheResultsInMemory=True,
    CacheSolveResults=True,
    RemoteDefinitionLocation="http://127.0.0.1:5000/crvPointAtStart",
    RemoteSolveVersion=(0, 1, 0),
    ShowInput_Enabled=False,
    ShowInput_Path=False,
    SynchronousSolve=True)
# """
# curve TangentAtStart
# TangentAtStart
# rhino3dm.Vector3d: Evaluates the unit
# tangent vector at the start of the curve.
# ""
# crvTangentAtStart"
crvpointatend = Hops(
    Curve=curve,
    CacheResultsInMemory=True,
    CacheSolveResults=True,
    RemoteDefinitionLocation="http://127.0.0.1:5000/crvPointAtEnd",
    RemoteSolveVersion=(0, 1, 0),
    ShowInput_Enabled=False,
    ShowInput_Path=False,
    SynchronousSolve=True)
# """
# curve TangentAtEnd
# TangentAtEnd
# rhino3dm.Vector3d: Evaluates the unit
# tangent vector at the end of the curve.
# """
# crvTangentAtEnd
crvtangentatstart = Hops(
    Curve=curve,
    CacheResultsInMemory=True,
    CacheSolveResults=True,
    RemoteDefinitionLocation="http://127.0.0.1:5000/crvTangentAtStart",
    RemoteSolveVersion=(0, 1, 0),
    ShowInput_Enabled=False,
    ShowInput_Path=False,
    SynchronousSolve=True)
crvtangentatend = Hops(
    Curve=curve,
    CacheResultsInMemory=True,
    CacheSolveResults=True,
    RemoteDefinitionLocation="http://127.0.0.1:5000/crvTangentAtEnd",
    RemoteSolveVersion=(0, 1, 0),
    ShowInput_Enabled=False,
    ShowInput_Path=False,
    SynchronousSolve=True)
panel_2 = Panel(crvpointatstart)
panel_3 = Panel(crvtangentatend)
panel_4 = Panel(crvtangentatstart)
panel_5 = Panel(crvdimension)
panel_6 = Panel(crvisclosed)
panel_7 = Panel([crvdomaint0t1.T0, crvdomaint0t1.T1])
panel_8 = Panel(crvspancount)
panel_9 = Panel(crvdegree)
panel_10 = Panel(crvisperiodic)
# """
# static Create Control Point Curve
# staticCreateControlPointCurve(points, degree)
# Constructs a curve from a set of control-point locations.
# 
# Parameters:
# points (list[rhino3dm.Point3d]) – Control points.
# degree (int) – Degree of curve.
# The number of control points must be at least degree+1.
# Return type:
# rhino3dm.Curve
# """
# crvCP5
# """
# curve Change Dimension
# ChangeDimension(desiredDimension)
# Changes the dimension of a curve.
# 
# Parameters:	desiredDimension
# (int) – The desired dimension.
# Returns:	True if the curve’s
#  dimension was already desiredDimension
# or if the curve’s dimension was successfully
# changed to desiredDimension; otherwise false.
# Return type:	bool
# """
# crvChangeDimension
number_slider_6 = Slider(7, range=0..10)
# """
# curve IsLinear
# IsLinear(tolerance)
# Test a curve to see if it is linear
# to within RhinoMath.ZeroTolerance units (1e-12).
# 
# Returns:	True if the curve is linear.
# Return type:	bool
# """
# crvIsLinear
number_slider_7 = Slider(3, range=0..10)

# ----
# """curve try get polyline
# TryGetPolyline()
# Several types of Curve can have the form of a
# polyline including a degree 1 NurbsCurve,
# a PolylineCurve, and a PolyCurve all of
# whose segments are some form of polyline.
# IsPolyline tests a curve to see if it can be represented as a polyline.
# 
# Returns:	tuple (bool, rhino3dm.Polyline)
# True if this curve can be represented as a polyline; otherwise, false.
# If True is returned, then the polyline form is returned here.
# Return type:	(bool, rhino3dm.Polyline)
# """
# crvTryGetPolyline
# crvTryGetArc
# crvTryGetCircle
# crvTryGetEllipse
# """
# curve is arc
# IsArc(tolerance)
# Test a curve to see if it can be represented
# by an arc or circle within RhinoMath.ZeroTolerance.
# 
# Returns:	True if the curve can
# be represented by an arc or a circle within tolerance.
# Return type:	bool
# """
# crvIsArc
# crvIsCircle
# crvIsEllipse
geometry = Geometry(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)
crvtrygetpolyline = Hops(
    Curve=geometry,
    CacheResultsInMemory=True,
    CacheSolveResults=True,
    RemoteDefinitionLocation="http://127.0.0.1:5000/crvTryGetPolyline",
    RemoteSolveVersion=(0, 1, 0),
    ShowInput_Enabled=False,
    ShowInput_Path=False,
    SynchronousSolve=True)
panel_11 = Panel(crvtrygetpolyline)

circle = Circle(Plane=PlaneXY(0, 0, 0), Radius=1)
series = Series(Start=0, Step=1, Count=number_slider_6)
crvchangeclosedcurveseam = Hops(
    Curve=reparameterize(circle),
    Parameter=Slider(0.5, range=0..1),
    CacheResultsInMemory=True,
    CacheSolveResults=True,
    RemoteDefinitionLocation="http://127.0.0.1:5000/crvChangeClosedCurveSeam",
    RemoteSolveVersion=(0, 1, 0),
    ShowInput_Enabled=False,
    ShowInput_Path=False,
    SynchronousSolve=True)
panel_12 = Panel(crvchangeclosedcurveseam)
sine = Sine(Value=series)
multiplication = Multiplication(A=sine, B=Slider(11, range=0..100))
construct_point = ConstructPoint(XCoordinate=series, YCoordinate=series, ZCoordinate=multiplication)
subtraction = Subtraction(A=number_slider_6, B="1")
panel_13 = Panel(construct_point)
crvcp5 = Hops(
    Points=construct_point,
    Degree=subtraction,
    CacheResultsInMemory=False,
    CacheSolveResults=False,
    RemoteDefinitionLocation="http://127.0.0.1:5000/crvCP5",
    RemoteSolveVersion=(0, 1, 0),
    ShowInput_Enabled=False,
    ShowInput_Path=False,
    SynchronousSolve=True)
# """
# curve is planar
# IsPlanar(tolerance)
# Test a curve for planarity.
# 
# Returns:	True if the curve is planar (flat)
# to within RhinoMath.ZeroTolerance units (1e-12).
# Return type:	bool
# """
# crvIsPlanar
crvisarc = Hops(
    Curve=crvcp5,
    CacheResultsInMemory=True,
    CacheSolveResults=True,
    RemoteDefinitionLocation="http://127.0.0.1:5000/crvIsArc",
    RemoteSolveVersion=(0, 1, 0),
    ShowInput_Enabled=False,
    ShowInput_Path=False,
    SynchronousSolve=True)
# """
# curve change closed seam
# ChangeClosedCurveSeam(t)
# If this curve is closed, then modify it
# so that the start/end point is at
# curve parameter t.
# 
# Parameters:	t (float) – Curve parameter
# of new start/end point. The returned
# curves domain will start at t.
# Returns:	True on success, False on failure.
# Return type:	bool
# """
# /crvChangeClosedCurveSeam
crvisplanar = Hops(
    Curve=crvcp5,
    CacheResultsInMemory=True,
    CacheSolveResults=True,
    RemoteDefinitionLocation="http://127.0.0.1:5000/crvIsPlanar",
    RemoteSolveVersion=(0, 1, 0),
    ShowInput_Enabled=False,
    ShowInput_Path=False,
    SynchronousSolve=True)
# """
# curve is polyline
# IsPolyline()
# Several types of Curve can have the form
# of a polyline including a degree 1 NurbsCurve,
# a PolylineCurve, and a PolyCurve all of whose
# segments are some form of polyline.
# IsPolyline tests a curve to see if it can be represented as a polyline.
# 
# Returns:	True if this curve can be
# represented as a polyline; otherwise, false.
# Return type:	bool
# """
# crvIsPolyline
crvislinear = Hops(
    Curve=crvcp5,
    CacheResultsInMemory=True,
    CacheSolveResults=True,
    RemoteDefinitionLocation="http://127.0.0.1:5000/crvIsLinear",
    RemoteSolveVersion=(0, 1, 0),
    ShowInput_Enabled=False,
    ShowInput_Path=False,
    SynchronousSolve=True)
crvchangedimension = Hops(
    Curve=crvcp5,
    DesiredDimension=number_slider_7,
    CacheResultsInMemory=True,
    CacheSolveResults=True,
    RemoteDefinitionLocation="http://127.0.0.1:5000/crvChangeDimension",
    RemoteSolveVersion=(0, 1, 0),
    ShowInput_Enabled=False,
    ShowInput_Path=False,
    SynchronousSolve=True)
crvispolyline = Hops(
    Curve=crvcp5,
    CacheResultsInMemory=True,
    CacheSolveResults=True,
    RemoteDefinitionLocation="http://127.0.0.1:5000/crvIsPolyline",
    RemoteSolveVersion=(0, 1, 0),
    ShowInput_Enabled=False,
    ShowInput_Path=False,
    SynchronousSolve=True)
panel_14 = Panel(crvchangedimension)
panel_15 = Panel(crvisarc)
panel_16 = Panel(crvislinear)
panel_17 = Panel(crvisplanar)
panel_18 = Panel(crvispolyline)
panel_19 = Panel(crvcp5)
# """
# curve reverse
# Reverse()
# Reverses the direction of the curve.
# 
# Returns:	True on success, False on failure.
# Return type:	bool
# """
# crvReverse
number_slider_8 = Slider(15.33, range=0..100)
# crvSetStartPoint
# crvSetEndPoint
# crvTangentAt
# crvCurvatureAt
number_slider_9 = Slider(1, range=0..1)

# ----
# """
# curve close curve orientation
# ClosedCurveOrientation()
# Determines the orientation (counterclockwise or clockwise)
# of a closed, planar curve in the world XY plane.
# Only works with simple (no self intersections) closed, planar curves.
# 
# Returns:	The orientation of this curve with respect to world XY plane.
# Return type:	CurveOrientation
# """
# crvClosedCurveOrient
# """
# curve point at parameter
# PointAt(t)
# Evaluates point at a curve parameter.
# 
# Parameters:	t (float) – Evaluation parameter.
# Returns:	Point (location of curve at the parameter t).
# Return type:	rhino3dm.Point3d
# """
# crvPointAt
circle_2 = Circle(Plane=PlaneXY(0, 0, 0), Radius=1)
crvclosedcurveorient = Hops(
    Curve=circle_2,
    CacheResultsInMemory=True,
    CacheSolveResults=True,
    RemoteDefinitionLocation="http://127.0.0.1:5000/crvClosedCurveOrient",
    RemoteSolveVersion=(0, 1, 0),
    ShowInput_Enabled=False,
    ShowInput_Path=False,
    SynchronousSolve=True)
panel_20 = Panel(crvclosedcurveorient)

# ----
# """
# curve is closable
# IsClosable(tolerance, minimumAbsoluteSize,
# minimumRelativeSize)
# Decide if it makes sense to close off
# this curve by moving the endpoint to the
# start based on start-end gap size and
# length of curve as approximated by
# chord defined by 6 points.
# 
# Returns:	True if start and end points
# are close enough based on above conditions.
# Return type:	bool
# """
# crvIsClose
curve_2 = Curve(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)
curve_3 = Curve(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)
crvisclose = Hops(
    Curve=curve_2,
    Tolerance=Slider(7.56, range=0..100),
    MinimumAbsoluteSize=Slider(6.44, range=0..100),
    MinimumRelativeSize=number_slider_8,
    CacheResultsInMemory=True,
    CacheSolveResults=True,
    RemoteDefinitionLocation="http://127.0.0.1:5000/crvIsClose",
    RemoteSolveVersion=(0, 1, 0),
    ShowInput_Enabled=False,
    ShowInput_Path=False,
    SynchronousSolve=True)
crvpointat = Hops(
    Curve=reparameterize(circle_2),
    Parameter=number_slider_9,
    CacheResultsInMemory=True,
    CacheSolveResults=True,
    RemoteDefinitionLocation="http://127.0.0.1:5000/crvPointAt",
    RemoteSolveVersion=(0, 1, 0),
    ShowInput_Enabled=False,
    ShowInput_Path=False,
    SynchronousSolve=True)
crvreverse = Hops(
    Curve=curve_3,
    CacheResultsInMemory=True,
    CacheSolveResults=True,
    RemoteDefinitionLocation="http://127.0.0.1:5000/crvReverse",
    RemoteSolveVersion=(0, 1, 0),
    ShowInput_Enabled=False,
    ShowInput_Path=False,
    SynchronousSolve=True)
panel_21 = Panel(crvisclose)
panel_22 = Panel(crvpointat)
panel_23 = Panel(crvreverse)
# """
# FrameAt(t)
# Returns a 3d frame at a parameter.
# 
# Parameters:	t (float) – Evaluation parameter.
# Returns:	tuple (bool, rhino3dm.Plane)
# True on success, False on failure.
# The frame is returned here.
# Return type:	(bool, rhino3dm.Plane)
# """
# crvFrameAt
number_slider_10 = Slider(17, range=0..100)
# """
# curve get curve parameter form nurbs from parameter
# GetCurveParameterFromNurbsFormParameter(nurbsParameter)
# Convert a NURBS curve parameter to a curve parameter.
# 
# Parameters:	nurbsParameter (float) – NURBS form parameter.
# Returns:	tuple (bool, float)
# True on success, False on failure.
# Curve parameter.
# Return type:	(bool, float)
# """
# crvGetCurveParameterFromNurbsFormParameter
number_slider_11 = Slider(7, range=0..10)
curve_4 = Curve(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)
# """
# curve trim(t0, t1)
# Trim(t0, t1)
# Removes portions of the curve outside the specified interval.
# 
# Parameters:
# t0 (float) – Start of the trimming interval. Portions of the curve before curve(t0) are removed.
# t1 (float) – End of the trimming interval. Portions of the curve after curve(t1) are removed.
# Returns:
# Trimmed portion of this curve is successful, None on failure.
# 
# Return type:
# rhino3dm.Curve
# """
# crvTrim
number_slider_12 = Slider(0.3, range=0..1)
# """
# curve split(t)
# Split(t)
# Splits (divides) the curve at the specified parameter.
# The parameter must be in the interior of the curve’s domain.
# 
# Parameters:	t (float) – Parameter to split the curve at in
# the interval returned by Domain().
# Returns:	Two curves on success, None on failure.
# Return type:	rhino3dm.Curve[]
# """
# crvSplit
number_slider_13 = Slider(0.64, range=0..1)
# """
# curve to nurbs curve
# ToNurbsCurve()
# Constructs a NURBS curve representation of this curve.
# 
# Returns:	NURBS representation of the curve on success, None on failure.
# Return type:	rhino3dm.NurbsCurve
# """
number_slider_14 = Slider(0.42, range=0..1)
# """
# curve get nurbs form parameter from curve parameter
# GetNurbsFormParameterFromCurveParameter(curveParameter)
# Convert a curve parameter to a NURBS curve parameter.
# 
# Parameters:	curveParameter (float) – Curve parameter.
# Returns:	tuple (bool, float)
# True on success, False on failure.
# NURBS form parameter.
# Return type:	(bool, float)
# """
# crvGetNurbsFormParameterFromCurveParameter
number_slider_15 = Slider(0.73, range=0..1)
# ToNurbsCurve(subdomain)
# Constructs a NURBS curve representation of this curve.
# 
# Returns:	NURBS representation of the curve on success,
# None on failure.
# Return type:	rhino3dm.NurbsCurve
number_slider_16 = Slider(0.44, range=0..1)
circle_3 = Circle(Plane=PlaneXY(0, 0, 0), Radius=number_slider_10)
range = Range(Domain=Slider(0.92, range=0..1), Steps=number_slider_11)
hops = Hops(
    Curve=reparameterize(curve_4),
    CacheResultsInMemory=True,
    CacheSolveResults=True,
    RemoteDefinitionLocation="http://127.0.0.1:5000/crvToNurbsCurve",
    RemoteSolveVersion=(0, 1, 0),
    ShowInput_Enabled=False,
    ShowInput_Path=False,
    SynchronousSolve=True)
crvsplit = Hops(
    Curve=reparameterize(curve_4),
    Parameter=number_slider_14,
    CacheResultsInMemory=True,
    CacheSolveResults=True,
    RemoteDefinitionLocation="http://127.0.0.1:5000/crvSplit",
    RemoteSolveVersion=(0, 1, 0),
    ShowInput_Enabled=False,
    ShowInput_Path=False,
    SynchronousSolve=True)  # -> First, Second
crvtrim = Hops(
    Curve=reparameterize(curve_4),
    Start=number_slider_12,
    End=number_slider_13,
    CacheResultsInMemory=True,
    CacheSolveResults=True,
    RemoteDefinitionLocation="http://127.0.0.1:5000/crvTrim",
    RemoteSolveVersion=(0, 1, 0),
    ShowInput_Enabled=False,
    ShowInput_Path=False,
    SynchronousSolve=True)
crvgetcurveparameterfromnurbsformparamet = Hops(
    Curve=reparameterize(curve_4),
    NurbsFormParameter=number_slider_15,
    CacheResultsInMemory=True,
    CacheSolveResults=True,
    RemoteDefinitionLocation="http://127.0.0.1:5000/crvGetCurveParameterFromNurbsFormParameter",
    RemoteSolveVersion=(0, 1, 0),
    ShowInput_Enabled=False,
    ShowInput_Path=False,
    SynchronousSolve=True)  # -> Success, CurveParameter; "crvGetCurveParameterFromNurbsFormParameter"
evaluate_curve = EvaluateCurve(Curve=hops, Parameter=number_slider_16)  # -> Point, Tangent, Angle
crvframeat = Hops(
    Curve=reparameterize(circle_3),
    Parameter=range,
    CacheResultsInMemory=True,
    CacheSolveResults=True,
    RemoteDefinitionLocation="http://127.0.0.1:5000/crvFrameAt",
    RemoteSolveVersion=(0, 1, 0),
    ShowInput_Enabled=False,
    ShowInput_Path=False,
    SynchronousSolve=True)  # -> Success, Origin, X, Y, Z
panel_24 = Panel(crvtrim)
curve_5 = Curve(crvsplit.First)
curve_6 = Curve(crvsplit.Second)
panel_25 = Panel(crvgetcurveparameterfromnurbsformparamet.Success)
panel_26 = Panel(crvgetcurveparameterfromnurbsformparamet.CurveParameter)
panel_27 = Panel([curve_5, curve_6])
panel_28 = Panel(hops)
panel_29 = Panel([evaluate_curve.Point, evaluate_curve.Tangent, evaluate_curve.Angle])
vector_xyz = VectorXYZ(XComponent=crvframeat.Y, YComponent=crvframeat.Y, ZComponent=crvframeat.Z)  # -> Vector, Length
pi = Pi(Factor=Slider(1.6, range=0..2))
construct_plane = ConstructPlane(Origin=crvframeat.Origin, XAxis=crvframeat.X, YAxis=vector_xyz.Vector)
rotate_3d = Rotate3D(Geometry=construct_plane, Angle=pi, Center=crvframeat.Origin, Axis=Vector(0, 0, 1))  # -> Geometry, Transform
ellipse = Ellipse(Plane=rotate_3d.Geometry, Radius1=Slider(2.46, range=0..10), Radius2=Slider(3.5, range=0..10))  # -> graft(Ellipse), Focus1, Focus2
panel_30 = Panel(ellipse.Ellipse)
explode_tree_2 = ExplodeTree(Data=ellipse.Ellipse)  # -> Branch0, Branch1, Branch2, Branch3, Branch4, Branch5, Branch6, Branch7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
loft = Loft(
    Curves=flatten([explode_tree_2.Branch0, explode_tree_2.Branch1, explode_tree_2.Branch2, explode_tree_2.Branch3, explode_tree_2.Branch4, explode_tree_2.Branch5, explode_tree_2.Branch6, explode_tree_2.Branch7, explode_tree_2.Branch8, explode_tree_2.Branch9]),
    Options={Adjust=False, Closed=False, LoftEnds=0, LoftSimp=0, LoftType=0, Rebuild=10, Refit=0.01})
loft_2 = Loft(
    Curves=flatten([explode_tree_2.Branch1, explode_tree_2.Branch2]),
    Options={Adjust=False, Closed=False, LoftEnds=0, LoftSimp=0, LoftType=0, Rebuild=10, Refit=0.01})
loft_3 = Loft(
    Curves=flatten([explode_tree_2.Branch2, explode_tree_2.Branch3]),
    Options={Adjust=False, Closed=False, LoftEnds=0, LoftSimp=0, LoftType=0, Rebuild=10, Refit=0.01})
loft_4 = Loft(
    Curves=flatten([explode_tree_2.Branch3, explode_tree_2.Branch4]),
    Options={Adjust=False, Closed=False, LoftEnds=0, LoftSimp=0, LoftType=0, Rebuild=10, Refit=0.01})
loft_5 = Loft(
    Curves=flatten([explode_tree_2.Branch4, explode_tree_2.Branch5]),
    Options={Adjust=False, Closed=False, LoftEnds=0, LoftSimp=0, LoftType=0, Rebuild=10, Refit=0.01})
loft_6 = Loft(
    Curves=flatten([explode_tree_2.Branch5, explode_tree_2.Branch6]),
    Options={Adjust=False, Closed=False, LoftEnds=0, LoftSimp=0, LoftType=0, Rebuild=10, Refit=0.01})
loft_7 = Loft(
    Curves=flatten([explode_tree_2.Branch6, explode_tree_2.Branch7]),
    Options={Adjust=False, Closed=False, LoftEnds=0, LoftSimp=0, LoftType=0, Rebuild=10, Refit=0.01})
loft_8 = Loft(
    Curves=flatten([explode_tree_2.Branch7, explode_tree_2.Branch8]),
    Options={Adjust=False, Closed=False, LoftEnds=0, LoftSimp=0, LoftType=0, Rebuild=10, Refit=0.01})
loft_9 = Loft(
    Curves=flatten([explode_tree_2.Branch8, explode_tree_2.Branch9]),
    Options={Adjust=False, Closed=False, LoftEnds=0, LoftSimp=0, LoftType=0, Rebuild=10, Refit=0.01})
loft_10 = Loft(
    Curves=flatten([explode_tree_2.Branch9, explode_tree_2.Branch10]),
    Options={Adjust=False, Closed=False, LoftEnds=0, LoftSimp=0, LoftType=0, Rebuild=10, Refit=0.01})
loft_11 = Loft(
    Curves=flatten([explode_tree_2.Branch10, explode_tree_2.Branch0]),
    Options={Adjust=False, Closed=False, LoftEnds=0, LoftSimp=0, LoftType=0, Rebuild=10, Refit=0.01})
loft_12 = Loft(
    Curves=flatten([explode_tree_2.Branch0, explode_tree_2.Branch1]),
    Options={Adjust=False, Closed=False, LoftEnds=0, LoftSimp=0, LoftType=0, Rebuild=10, Refit=0.01})
cap_holes = CapHoles(Brep=loft)
deconstruct_brep_2 = DeconstructBrep(Brep=cap_holes)  # -> Faces, Edges, Vertices
list_item = ListItem(List=deconstruct_brep_2.Faces, Index=0, Wrap=True)  # -> Item, Item1, Item2
area = Area(Geometry=[list_item.Item2, list_item.Item1])  # -> Area, Centroid
sphere = Sphere(Base=area.Centroid, Radius=Slider(4.29, range=0..10))
merge_2 = Merge(
    Data1=loft_12,
    Data2=loft_2,
    Data3=loft_3,
    Data4=loft_4,
    Data5=loft_5,
    Data6=loft_6,
    Data7=loft_7,
    Data8=loft_8,
    Data9=loft_9,
    Data10=loft_10,
    Data11=loft_11)
solid_union = SolidUnion(Breps=flatten([sphere, cap_holes]))
