# Grasshopper definition rhino3dm_hops_surfaces_003.gh (Grasshopper 1.0.7)
# plug-ins: Hops

# ----
# createVector
# Breps
# Surfaces
# Points
# Curves
# createLine
# createCurve
number_slider = Slider(15, range=0..100)
number_slider_2 = Slider(35, range=0..100)
number_slider_3 = Slider(45, range=0..100)
number_slider_4 = Slider(6, range=0..100)
# hops server with flask
# rhino3dm in app.py
# Getting Started with
# rhino3dm development
# API for Python 3.10
number_slider_5 = Slider(17, range=0..100)
createpoint = Hops(
    X=[number_slider, number_slider_2, number_slider_3],
    Y=[number_slider, number_slider_2, number_slider_3, number_slider_4],
    Z=[number_slider, number_slider_3, number_slider_4],
    CacheResultsInMemory=True,
    CacheSolveResults=True,
    RemoteDefinitionLocation="http://127.0.0.1:5000/createpoint",
    RemoteSolveVersion=(0, 1, 0),
    ShowInput_Enabled=False,
    ShowInput_Path=False,
    SynchronousSolve=True)
explode_tree = ExplodeTree(Data=graft(createpoint))  # -> Branch0, Branch1, Branch2, Branch3
createvector = Hops(
    X=number_slider_5,
    Y=number_slider_5,
    Z=number_slider_5,
    CacheResultsInMemory=True,
    CacheSolveResults=True,
    RemoteDefinitionLocation="http://127.0.0.1:5000/createVector",
    RemoteSolveVersion=(0, 1, 0),
    ShowInput_Enabled=False,
    ShowInput_Path=False,
    SynchronousSolve=True)
panel = Panel(createvector)
createcurve = Hops(
    Start=explode_tree.Branch0,
    End=explode_tree.Branch1,
    CacheResultsInMemory=True,
    CacheSolveResults=True,
    RemoteDefinitionLocation="http://127.0.0.1:5000/createCurve",
    RemoteSolveVersion=(0, 1, 0),
    ShowInput_Enabled=False,
    ShowInput_Path=False,
    SynchronousSolve=True)
createcurve_2 = Hops(
    Start=explode_tree.Branch2,
    End=explode_tree.Branch3,
    CacheResultsInMemory=True,
    CacheSolveResults=True,
    RemoteDefinitionLocation="http://127.0.0.1:5000/createLine",
    RemoteSolveVersion=(0, 1, 0),
    ShowInput_Enabled=False,
    ShowInput_Path=False,
    SynchronousSolve=True)
createsurface = Hops(
    CornerA=explode_tree.Branch0,
    CornerB=explode_tree.Branch1,
    CornerC=explode_tree.Branch2,
    CornerD=explode_tree.Branch3,
    CacheResultsInMemory=True,
    CacheSolveResults=True,
    RemoteDefinitionLocation="http://127.0.0.1:5000/createSurface",
    RemoteSolveVersion=(0, 1, 0),
    ShowInput_Enabled=False,
    ShowInput_Path=False,
    SynchronousSolve=True)
merge = Merge(Data1=explode_tree.Branch0, Data2=explode_tree.Branch1, Data3=explode_tree.Branch2, Data4=explode_tree.Branch3)  # -> flatten(Result)
createbrep = Hops(
    Surface=createsurface,
    CacheResultsInMemory=True,
    CacheSolveResults=True,
    RemoteDefinitionLocation="http://127.0.0.1:5000/createBrep",
    RemoteSolveVersion=(0, 1, 0),
    ShowInput_Enabled=False,
    ShowInput_Path=False,
    SynchronousSolve=True)
polyline = PolyLine(Vertices=merge, Closed=False)
deconstruct_brep = DeconstructBrep(Brep=createbrep)  # -> Faces, Edges, Vertices

number_slider_6 = Slider(23, range=0..100)
curve = Curve(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)
unit_x = UnitX(Factor=number_slider_6)
move = Move(Geometry=curve, Motion=unit_x)  # -> Geometry, Transform
loft = Loft(
    Curves=flatten([curve, move.Geometry]),
    Options={Adjust=False, Closed=False, LoftEnds=0, LoftSimp=0, LoftType=0, Rebuild=10, Refit=0.01})
sphere = Sphere(Base=PlaneXY(0, 0, 0), Radius=number_slider_6)
# """
# surface is solid
# IsSolid
# bool: Gets a values indicating
# whether a surface is solid.
# """
# srfIsSolid
surface = Surface(loft)
# class
# rhino3dm.Surface
srfissolid = Hops(
    Surface=[surface, sphere],
    CacheResultsInMemory=True,
    CacheSolveResults=True,
    RemoteDefinitionLocation="http://127.0.0.1:5000/srfIsSolid",
    RemoteSolveVersion=(0, 1, 0),
    ShowInput_Enabled=False,
    ShowInput_Path=False,
    SynchronousSolve=True)
panel_2 = Panel(srfissolid)
